# Grasshopper definition 20210708_first_test_RR.gh (Grasshopper 1.0.7)

crv = Curve(reparameterize(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))
divide = DivideCurve(Curve=crv, Count=Slider(200, range=0..1000), Kinks=False)  # -> Points, Tangents, Parameters
lng = ListLength(List=divide.Points)
domain = Domain(Domain(0, 1))
range = Range(Domain=domain, Steps=lng)
graph = GraphMapper(range, x0=0, x1=1, y0=0, y1=1, Cx=0.3466837406, Cy=0.6010273695, container_name="Conic")
multiplication = Multiplication(A=graph, B=Slider(20, range=0..100))
symsim = SymbolSimple(Style=Slider(5, range=0..15), Size=multiplication, Rotation=0, Colour=ColourSwatch(SwatchColor=RGB(0, 0, 0)))
symbol = SymbolDisplay(Location=divide.Points, Display=symsim)
