# Grasshopper definition example02.ghx (Grasshopper 1.0.7)

reload = Button()
py = GhPythonScript()  # -> WEB, DATA
# ---------- py: Python ----------
import sys
import os

filepath = os.path.dirname(ghenv.Component.OnPingDocument().FilePath)

LIB = os.path.join(filepath, "..", "src")
LIB = os.path.abspath(LIB)

sys.path.append(LIB)

from workshop_sjsu import DATA
from workshop_sjsu import WEB
# ---------- end py ----------
panel = Panel("1.a) Define planar curve/s")
panel_2 = Panel("1.b) Run simulation")
py_2 = PythonScript(reload=reload)
# ---------- py_2: Python ----------
if reload:
    from compas_ghpython import unload_modules
    unload_modules('compas')
    unload_modules('workshop_sjsu')
    unload_modules('compas_fab')
# ---------- end py_2 ----------

# ----
# Parameters
number_slider = Slider(0.99, range=0..10)

python = GhPythonScript(num=Slider(97, range=0..1000), q=Slider(0.24, range=0..1), factor=Slider(0.11, range=0..1))  # -> pts; inputs num: Int32
# ---------- python: Python ----------
import Rhino.Geometry as rg
import math

P = rg.Point3d(0,0,0)
pts = []

start, end = 0, 200





for i in range(num):
    x = P.X + q * i * math.cos(q * i) * factor
    y = P.Y + q * i * math.sin(q * i) * factor
    pts.append(rg.Point3d(x, y, 0))
# ---------- end python ----------
polar = ToPolar(Point=python, System=PlaneXY(0, 0, 0))  # -> Phi, Theta, Radius

# ----
# Boundary
# Change radius to fit the curve into the circle
number_slider_2 = Slider(2.4, range=0..100)
xy = XYPlane(Origin=Point(0, 0, 0))
cir = Circle(Plane=xy, Radius=number_slider_2)
circle = Circle(cir)

python_2 = GhPythonScript(DATA=py.DATA, filename="example03.json")  # -> filepath
# ---------- python_2: Python ----------
import os

filepath = os.path.join(DATA, filename)
# ---------- end python_2 ----------
python_3 = GhPythonScript(DATA=py.DATA, filename="example02.json")  # -> filepath; same code as python_2

# ----
# Sphere
py_3 = GhPythonScript()  # -> sphere; unedited script template
sphere = Geometry(py_3)

python_4 = GhPythonScript(sphere=sphere, circle=circle, P=polar.Phi, R=polar.Radius, scale=Slider(1.7, range=0.3..2.5))  # -> P; inputs sphere: Surface
# ---------- python_4: Python ----------
import math
import Rhino.Geometry as rg
from compas_fab.utilities import map_range

crv = sphere.IsoCurve(1, P)


R = map_range(R, 0, circle.Radius, -math.pi/2, math.pi/2 - scale)

P = crv.PointAt(R)
# ---------- end python_4 ----------
nurbs = NurbsCurve(Vertices=python_4, Degree=3, Periodic=False)  # -> Curve, Length, Domain
divide = DivideCurve(Curve=nurbs.Curve, Count=Slider(300, range=0..1000), Kinks=False)  # -> Points, Tangents, Parameters
# todo : optimise before saving
number_slider_3 = Slider(0.002, range=0..0.01)
number_slider_4 = Slider(0.05, range=0..0.1)

# ----
# Spirograph
spirograph = GhPythonScript(
    R=number_slider,
    r=Slider(1.89, range=-2..2),
    d=Slider(1, range=-2..2),
    theta=Slider(0.02, range=0..1),
    steps=Slider(28, range=0..100))  # -> lines
# ---------- spirograph: Python ----------
from math import sin, cos, pi
import Rhino.Geometry as rg


points = [] #empty list to put points in

steps = int(steps * pi /theta)

for t in range(0, steps):
    t *= theta
    x = (R - r) * cos(t) + d * cos(((R-r)/r) * t)
    y = (R - r) * sin(t) - d * sin(((R-r)/r) * t)
    points.append(rg.Point3d(x,y,0))
    
lines = []
for p1, p2 in zip(points[:-1], points[1:]):
    lines.append(rg.Line(p1, p2))
# ---------- end spirograph ----------
join = JoinCurves(Curves=spirograph, Preserve=False)
# 3. Define boundary circle
# (increase or decrease radius until it fits)
crv = Curve(join)
py_4 = GhPythonScript(crv=crv)  # -> P
# ---------- py_4: Python ----------
import rhinoscriptsyntax as rs

P = rs.CurvePoints(crv)
# ---------- end py_4 ----------

dam = DataDam(DataA=py_4, BufferDelay=10000000, BufferMode=0)

pt = Point(dam)

# ----
# Gradient
# circle to check if gradient works
python_5 = GhPythonScript(circle=circle, points=pt)  # -> Pn; inputs points: list
# ---------- python_5: Python ----------
import Rhino.Geometry as rg


Pn = []
for point in points:
    if circle.ToNurbsCurve().Contains(point, rg.Plane.WorldXY) == rg.PointContainment.Inside:
        point_new = (point + rg.Vector3d(circle.Radius, circle.Radius, 0))/(2 * circle.Radius)
        Pn.append(point_new)
# ---------- end python_5 ----------
# Create your own or look into workshop_sjsu\images for other gradients.
# ATTENTION: If you create your own, please make them the same size of 100x100 px.
image = ImageSampler(
    python_5,
    FilePath="C:\Users\rustr\workspace\teaching\workshop_sjsu\images\gradient-03.png",
    Filter="Value",
    Interpolate=False,
    Umax=1,
    Umin=0,
    Vmax=1,
    Vmin=0,
    Wrap=1)

python_6 = GhPythonScript(points=divide.Points, values=image)  # -> data; inputs points: list, values: list
# ---------- python_6: Python ----------
data = {}
data['points'] = [[p.X, p.Y, p.Z] for p in points]
data['values'] = list(values)

data = [data]
# ---------- end python_6 ----------
to_json = ToJSON(data=python_6, filepath=python_2, pretty=Toggle(True))  # -> json; inputs pretty: Boolean
#   port data: COMPAS data objects to serialize.
#   port filepath: File path where to store the JSON file. If empty, it will not store to disk but instead return the JSON string.
#   port pretty: If True, JSON data will be formatted with indentation and key sorting.
#   port json: JSON file path or JSON string.
# ---------- to_json: Python ----------
"""
Serializes COMPAS objects to JSON.
"""
from ghpythonlib.componentbase import executingcomponent as component

import compas


class CompasInfo(component):
    def RunScript(self, data, filepath, pretty):
        json = filepath

        if filepath:
            compas.json_dump(data, filepath, pretty)
        else:
            json = compas.json_dumps(data, pretty)

        return json
# ---------- end to_json ----------
multiplication = Multiplication(A=image, B=Slider(0.06, range=0..1))

cir_2 = Circle(Plane=pt, Radius=multiplication)

# ----
# Map curves on sphere
number_slider_5 = Slider(0.006, range=0..0.01)
polar_2 = ToPolar(Point=pt, System=PlaneXY(0, 0, 0))  # -> Phi, Theta, Radius
multiplication_2 = Multiplication(A=image, B=number_slider_5)
python_7 = GhPythonScript(sphere=sphere, circle=circle, P=polar_2.Phi, R=polar_2.Radius, scale=Slider(1.7, range=0.3..2.5))  # -> P; inputs sphere: Surface; same code as python_4
swatch = ColourSwatch(SwatchColor=RGB(0, 255, 123))

nurbs_2 = NurbsCurve(Vertices=python_7, Degree=3, Periodic=False)  # -> Curve, Length, Domain
divide_2 = DivideCurve(Curve=nurbs_2.Curve, Count=Slider(300, range=0..1000), Kinks=False)  # -> Points, Tangents, Parameters
python_8 = GhPythonScript(points=divide_2.Points, values=image)  # -> data; inputs points: list, values: list; same code as python_6
to_json_2 = ToJSON(data=python_8, filepath=python_3, pretty=Toggle(True))  # -> json; inputs pretty: Boolean; same code as to_json
python_9 = GhPythonScript(t=divide_2.Parameters, R=number_slider_3)  # -> out, R; inputs t: list
# ---------- python_9: Python ----------
R = [R for _ in range(len(t))]
# ---------- end python_9 ----------

vpipe = PipeVariable(Curve=nurbs_2.Curve, Parameters=divide_2.Parameters, Radii=python_9.R, Caps=0)
preview = CustomPreview(Geometry=vpipe, Material=swatch)

# ----
# Export
# 4. Press data dam to convert to mesh, change name if necessary and export for VR viewer
dam_2 = DataDam(DataA=vpipe, BufferDelay=10000000, BufferMode=0)
mesh = MeshBrep(
    Brep=dam_2,
    Settings={GridMaxCount=0, GridMinCount=16, JaggedSeams=False, MaxEdgeLength=0, MinEdgeLength=0.0001, MinTolerance=0, Refine=True, RefineAngle=0, RelativeTolerance=0.65, SimplePlanes=True, Tolerance=0})

py_5 = GhPythonScript(M=mesh)  # -> meshes; inputs M: list
# ---------- py_5: Python ----------
from compas_rhino.geometry import RhinoMesh

meshes = [RhinoMesh.from_geometry(m).to_compas() for m in M]
# ---------- end py_5 ----------

python_10 = GhPythonScript(meshes=py_5, name="example03", color=swatch, write=Button())  # -> out; inputs meshes: list
# ---------- python_10: Python ----------
from compas_rhino.geometry import RhinoMesh
from workshop_sjsu.glb_viewer import create_glb_viewer
from compas.utilities import color_to_rgb

color = color_to_rgb([color.R, color.G, color.B], normalize=True)

if write:
    create_glb_viewer(name, meshes, color)
# ---------- end python_10 ----------
# Run localhost.py and open
# 
# http://127.0.0.1:8000/example03.html
# in your browser
panel_3 = Panel(python_10)
