# Grasshopper definition example03.ghx (Grasshopper 1.0.7)

pt = Point([Point(-2.124520473, -0.5605575588, 0), Point(-0.3418679985, 1.77380819, 0), Point(0.4997767857, -2.209993728, 0), Point(3.785303129, -1.241541982, 0)])
# 3. Define boundary circle
# (increase or decrease radius until it fits)
number_slider = Slider(3, range=0..10)
python = GhPythonScript(num=Slider(10, range=0..10), step=Slider(0.5, range=0..10))  # -> P; inputs num: Int32
# ---------- python: Python ----------
import math
import Rhino.Geometry as rg


P = []
for i in range(num):
    circle = rg.Circle(rg.Plane.WorldXY, step * (i + 1))
    u = 2 * math.pi * circle.Radius
    div = int(round(u/step))
    crv = circle.ToNurbsCurve()
    params = crv.DivideByCount(div, True)
    [P.append(crv.PointAt(p)) for p in params]
# ---------- end python ----------
python_2 = GhPythonScript(points2d=python, attractors=pt, scale=Slider(0.07, range=0..1), influence=number_slider)  # -> out, C, L, R, I; inputs points2d: list, attractors: list
# ---------- python_2: Python ----------
import Rhino.Geometry as rg
from ghpythonlib.treehelpers import list_to_tree
 
C = []
L = []
R = []

for p in points2d:
    distance = 0
    vector = rg.Vector3d(0,0,0)
    for a in attractors:
        d = p.DistanceTo(a)
        if d < influence: 
            distance += d
            v = (p - a)
            vector += v
    c = rg.Circle(rg.Plane(p, rg.Vector3d.XAxis, rg.Vector3d.YAxis), distance/20)
    C.append(c)
    R.append([c.Radius, c.Radius])
    L.append(rg.Line(p - vector * scale, p + vector * scale))


v = [x for y in R for x in y]
I = rg.Interval(min(v), max(v))

R = list_to_tree(R)
# ---------- end python_2 ----------
geo = Geometry(python_2.C)
crv = Curve(python_2.L)

reload = Button()
panel = Panel("Example 03: Attractors")
py = GhPythonScript()  # -> name, WEB, DATA
# ---------- py: Python ----------
import sys
import os

filepath = os.path.dirname(ghenv.Component.OnPingDocument().FilePath)

name = os.path.basename(ghenv.Component.OnPingDocument().FilePath)
name = os.path.splitext(name)[0]

LIB = os.path.join(filepath, "..", "src")
LIB = os.path.abspath(LIB)

sys.path.append(LIB)

from workshop_sjsu import DATA
from workshop_sjsu import WEB
# ---------- end py ----------
panel_2 = Panel(py.name)
py_2 = PythonScript(reload=reload)
# ---------- py_2: Python ----------
if reload:
    from compas_ghpython import unload_modules
    unload_modules('compas')
    unload_modules('workshop_sjsu')
    unload_modules('compas_fab')
# ---------- end py_2 ----------

# ----
# Boundary
# Change radius to fit the curve into the circle
number_slider_2 = Slider(6, range=0..100)
xy = XYPlane(Origin=Point(0, 0, 0))
cir = Circle(Plane=xy, Radius=number_slider_2)
circle = Circle(cir)

# ----
# Note: Don't save the file into a different folder
name = Data(panel_2)

# ----
# Resolution
# Define resolution of the curve, ideally not higher than 1000 points
number_slider_3 = Slider(0.6, range=0.1..20)
py_3 = GhPythonScript(C=crv, N=number_slider_3, circle=circle)  # -> points2d, points2d_n, crv, params
# ---------- py_3: Python ----------
import Rhino.Geometry as rg



points2d = [C.PointAtStart, C.PointAtEnd]

points2d_n = []
for point in points2d:
    point_new = (point + rg.Vector3d(circle.Radius, circle.Radius, 0))/(2 * circle.Radius)
    points2d_n.append(point_new)
    

crv = rg.Curve.CreateControlPointCurve(points2d)
params = [rg.Curve.ClosestPoint(crv, pt)[1] for pt in points2d]
# ---------- end py_3 ----------
pt_2 = Point(py_3.points2d)

# ----
# Create your own or look into workshop_sjsu\images for other gradients.
# ATTENTION: If you create your own, please make them the same size of 100x100 px.
remap = RemapNumbers(Value=python_2.R, Source=python_2.I, Target=Domain(0.01, 1))  # -> Mapped, Clipped
data = Data(remap.Mapped)

# ----
# Gradient
# Color
image = ImageSampler(
    py_3.points2d_n,
    FilePath="C:\Users\rustr\workspace\teaching\workshop_sjsu\images\gradient-05.png",
    Filter="Colour",
    Interpolate=False,
    Umax=1,
    Umin=0,
    Vmax=1,
    Vmin=0,
    Wrap=1)
multiplication = Multiplication(A=data, B=Slider(0.26, range=0..5))
gradient = Number(data)
cloud = CloudDisplay(Points=py_3.points2d, Colours=image, Size=multiplication, SpriteType=0)

dam = DataDam(DataA=gradient, BufferDelay=10000000, BufferMode=0)
dam_2 = DataDam(DataA=py_3.points2d, BufferDelay=10000000, BufferMode=0)

# ----
# Sphere
py_4 = GhPythonScript()  # -> sphere; unedited script template
sphere = Geometry(py_4)
preview = CustomPreview(Geometry=sphere, Material=ColourSwatch(SwatchColor=RGBA(255, 255, 255, 76)))

python_3 = GhPythonScript(sphere=sphere, circle=circle, points2d=dam_2, scale=Slider(1.34, range=0.3..2.5))  # -> P, points3d; inputs sphere: Surface, points2d: list
# ---------- python_3: Python ----------
from workshop_sjsu.rhino.utilities import map2sphere


points3d = map2sphere(sphere, circle, points2d, scale)
# ---------- end python_3 ----------

# ----
# Map curves on sphere
# change here to scale
points3d = Point(python_3.points3d)

# ----
# Export for robot
python_4 = GhPythonScript(points3d=points3d, gradients=dam, colors=image)  # -> data; inputs points3d: tree, gradients: tree, colors: tree
# ---------- python_4: Python ----------
from workshop_sjsu.rhino.utilities import format_data_for_export

data = format_data_for_export(points3d, gradients, colors)

data = [data]
# ---------- end python_4 ----------
python_5 = GhPythonScript(DATA=py.DATA, name=name)  # -> filepath
# ---------- python_5: Python ----------
import os

filename = name + ".json"
filepath = os.path.join(DATA, filename)
print filepath
# ---------- end python_5 ----------
to_json = ToJSON(data=python_4, filepath=python_5, pretty=Toggle(True))  # -> json; inputs pretty: Boolean
#   port data: COMPAS data objects to serialize.
#   port filepath: File path where to store the JSON file. If empty, it will not store to disk but instead return the JSON string.
#   port pretty: If True, JSON data will be formatted with indentation and key sorting.
#   port json: JSON file path or JSON string.
# ---------- to_json: Python ----------
"""
Serializes COMPAS objects to JSON.
"""
from ghpythonlib.componentbase import executingcomponent as component

import compas


class CompasInfo(component):
    def RunScript(self, data, filepath, pretty):
        json = filepath

        if filepath:
            compas.json_dump(data, filepath, pretty)
        else:
            json = compas.json_dumps(data, pretty)

        return json
# ---------- end to_json ----------

# ----
# Visualisation
number_slider_4 = Slider(0.01, range=0..0.04)
python_6 = GhPythonScript(points3d=points3d, gradients=dam, scale=Slider(0.008, range=0..0.01))  # -> crv, params, radii; inputs points3d: list, gradients: list
# ---------- python_6: Python ----------
import Rhino.Geometry as rg
import scriptcontext


crv = rg.Curve.CreateControlPointCurve(points3d)
params = [crv.ClosestPoint(pt)[1] for pt in points3d]
radii = [r*scale for r in gradients]
# ---------- end python_6 ----------
vpipe = PipeVariable(Curve=python_6.crv, Parameters=python_6.params, Radii=python_6.radii, Caps=0)  # -> flatten(Pipe)
multiplication_2 = Multiplication(A=dam, B=number_slider_4)
colour_swatch = ColourSwatch(SwatchColor=RGB(0, 255, 123))
cloud_2 = CloudDisplay(Points=points3d, Colours=image, Size=multiplication_2, SpriteType=0)
preview_2 = CustomPreview(Geometry=vpipe, Material=colour_swatch)

for_mac = Panel("http://localhost:8080/USER/workshops/workshop_sjsu/web/example01.html")

# ----
# Export for view
# This takes some time ...
# 4. Press data dam to convert to mesh and export for html viewer
dam_3 = DataDam(DataA=vpipe, BufferDelay=10000000, BufferMode=0)
mesh = MeshBrep(
    Brep=dam_3,
    Settings={GridMaxCount=0, GridMinCount=16, JaggedSeams=False, MaxEdgeLength=0, MinEdgeLength=0.0001, MinTolerance=0, Refine=True, RefineAngle=0, RelativeTolerance=0.65, SimplePlanes=True, Tolerance=0})

py_5 = GhPythonScript(M=mesh)  # -> meshes; inputs M: list
# ---------- py_5: Python ----------
from workshop_sjsu.glb_viewer import transform_and_process_meshes_for_glb

meshes = transform_and_process_meshes_for_glb(M)
# ---------- end py_5 ----------

python_7 = GhPythonScript(meshes=py_5, name=name, color=colour_swatch, write=Button())  # -> out; inputs meshes: list
# ---------- python_7: Python ----------
from workshop_sjsu.glb_viewer import create_glb_viewer
from compas.utilities import color_to_rgb

color = color_to_rgb([color.R, color.G, color.B], normalize=True)

if write:
    create_glb_viewer(name, meshes, color)
# ---------- end python_7 ----------
# Run
# 
# workshop_sjsu/web/http-file-server.exe
# 
#  and open
# 
# http://localhost:8080/web/example03.html
# 
# in your browser
panel_3 = Panel(python_7)
