# Grasshopper definition setup.ghx (Grasshopper 1.0.7)

reload = Button()
py = GhPythonScript()  # -> WEB, DATA
# ---------- py: Python ----------
import sys
import os

filepath = os.path.dirname(ghenv.Component.OnPingDocument().FilePath)

#LIB = os.path.join(filepath, "..", "src")
LIB = os.path.join(filepath, "..", "..")
LIB = os.path.abspath(LIB)
print LIB
sys.path.append(LIB)

from workshop_sjsu import DATA
from workshop_sjsu import WEB
# ---------- end py ----------

# ----
# Robot
load = Button()
python = GhPythonScript(load=load)  # -> robot
# ---------- python: Python ----------
from scriptcontext import sticky as st

import compas

compas.PRECISION = '12f'

from compas_fab.robots.ur5 import Robot
from compas_ghpython.artists import RobotModelArtist


# Store robot in component-based key
robot_key = 'robot_{}'.format(str(ghenv.Component.InstanceGuid))

if robot_key not in st:
    st[robot_key] = None
    

if load:
    ur5 = Robot(load_geometry=True)
    ur5.artist = RobotModelArtist(ur5.model)
    st[robot_key] = ur5

robot = st[robot_key]
# ---------- end python ----------
robot = Data(python)

rad = Radians(Degrees=Slider(180, range=-360..1000))
vec = VectorXYZ(XComponent=rad, YComponent=0, ZComponent=0)  # -> Vector, Length
pt = Point(vec.Vector)
iso = IsoCurve(UVPoint=pt)  # -> UIsocurve, VIsocurve
crv = Curve(iso.VIsocurve)
rad_2 = Radians(Degrees=Slider(138, range=-360..1000))
xy = XYPlane(Origin=Point(0, 0, 0))
rotate = Rotate(Geometry=crv, Angle=rad_2, Plane=xy)  # -> Geometry, Transform
crv_2 = Curve(rotate.Geometry)
divide = DivideCurve(Curve=crv_2, Count=10, Kinks=False)  # -> Points, Tangents, Parameters
frame = CurveFrame(Curve=crv_2, Parameter=divide.Parameters)
py_2 = GhPythonScript(pln=frame)  # -> pln
# ---------- py_2: Python ----------
import Rhino.Geometry as rg
pln = rg.Plane(pln.Origin, -pln.ZAxis, pln.XAxis)
# ---------- end py_2 ----------
python_2 = GhPythonScript(robot=robot, planes=py_2)  # -> frames_tcf, frames_t0cf, planes_t0cf; inputs planes: list
# ---------- python_2: Python ----------
from compas.geometry import Frame
from compas_ghpython import draw_frame

frames_tcf = [Frame(pl.Origin, pl.XAxis, pl.YAxis) for pl in planes]

frames_t0cf = robot.from_tcf_to_t0cf(frames_tcf)


planes_t0cf = [draw_frame(f) for f in frames_t0cf]
# ---------- end python_2 ----------

# ----
# Tool
brep = Brep([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])
rotax = RotateAxis(Geometry=brep, Angle=1.570796327, Axis=Line((0, 0, 0), (0, 0.9573123013, 0)))  # -> Geometry, Transform
attach = BooleanToggle(True)
z_offset = Slider(0.078, range=-0.1..0.2)
mesh = MeshBrep(
    Brep=rotax.Geometry,
    Settings={GridMaxCount=0, GridMinCount=16, JaggedSeams=False, MaxEdgeLength=0, MinEdgeLength=0.0001, MinTolerance=0, Refine=True, RefineAngle=0, RelativeTolerance=0.65, SimplePlanes=True, Tolerance=0})
mjoin = MeshJoin(Meshes=mesh)
attach_tool = GhPythonScript(robot=robot, mesh=mjoin, attached=attach, z_offset=z_offset, name="light_pen")  # -> tool, data
# ---------- attach_tool: Python ----------
import os
from compas.geometry import Frame
from compas.datastructures import Mesh
from compas_fab.robots import PlanningScene
from compas_fab.robots import Tool
from compas_ghpython.artists import MeshArtist

from compas_rhino.geometry import RhinoMesh

# create tool from mesh and frame
mesh = RhinoMesh.from_geometry(mesh).to_compas()

#mesh.to_obj(r"C:\Users\rustr\workspace\teaching\workshop_sjsu\src\workshop_sjsu\data\tool.obj")
frame = Frame([z_offset, 0, 0], [0, 0, 1], [0, 1, 0])
tool = Tool(mesh, frame, name=name)

data = [tool.data]

if robot:
    if attached:
        robot.attach_tool(tool)
    else:
        if robot.attached_tool:
            robot.detach_tool()
# ---------- end attach_tool ----------
cluster = Cluster(filename="tool.json")  # disabled
to_json = ToJSON(data=attach_tool.data, filepath=cluster)  # -> json; inputs pretty: Boolean; disabled
#   port data: COMPAS data objects to serialize.
#   port filepath: File path where to store the JSON file. If empty, it will not store to disk but instead return the JSON string.
#   port pretty: If True, JSON data will be formatted with indentation and key sorting.
#   port json: JSON file path or JSON string.
# ---------- to_json: Python ----------
"""
Serializes COMPAS objects to JSON.
"""
from ghpythonlib.componentbase import executingcomponent as component

import compas


class CompasInfo(component):
    def RunScript(self, data, filepath, pretty):
        json = filepath

        if filepath:
            compas.json_dump(data, filepath, pretty)
        else:
            json = compas.json_dumps(data, pretty)

        return json
# ---------- end to_json ----------

# ----
# Sphere
pt_2 = Point(Point(0.4071428571, 0, 0.2266666667))
py_3 = GhPythonScript()  # -> sphere; unedited script template
move = Move(Geometry=py_3, Motion=pt_2)  # -> Geometry, Transform
sphere = Geometry(move.Geometry)
preview = CustomPreview(Geometry=sphere, Material=ColourSwatch(SwatchColor=RGBA(158, 158, 158, 53)))

# ----
# Camera
_360_camera = Geometry(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)
move_2 = Move(Geometry=_360_camera, Motion=pt_2)  # -> Geometry, Transform
xz = XZPlane(Origin=pt_2)
num = Number(1.570796327)
rotate_2 = Rotate(Geometry=move_2.Geometry, Angle=num, Plane=xz)  # -> Geometry, Transform
mesh_2 = MeshBrep(
    Brep=rotate_2.Geometry,
    Settings={GridMaxCount=0, GridMinCount=16, JaggedSeams=False, MaxEdgeLength=0, MinEdgeLength=0.0001, MinTolerance=0, Refine=True, RefineAngle=0, RelativeTolerance=0.65, SimplePlanes=True, Tolerance=0})
cluster_2 = Cluster_2(M=mesh_2)  # -> mesh, data; disabled
preview_2 = CustomPreview(Geometry=rotate_2.Geometry, Material=ColourSwatch(SwatchColor=RGB(0, 0, 0)))
cluster_3 = Cluster(filename="camera_in_position.json")  # disabled
to_json_2 = ToJSON(data=cluster_2.data, filepath=cluster_3)  # -> json; inputs pretty: Boolean; disabled; same code as to_json

number_slider = Slider(0.1, range=0..0.1)  # disabled
panel = Panel("example02.json")
number_slider_2 = Slider(0.25, range=0..1)  # disabled

python_3 = GhPythonScript(angle=Slider(10, range=0..100), step=Slider(1, range=0..10))  # -> out, A, V, frames
# ---------- python_3: Python ----------
import math
from compas.geometry import Frame
from workshop_sjsu.reachability import FrameGenerator
import Rhino.Geometry as rg

V = []
A = rg.Point3d(*list(frame.point))

frames = []



for xaxis in FrameGenerator.deviation_vectors_generator(frame.xaxis, math.radians(angle), step):
    print xaxis
    V.append(rg.Vector3d(*list(xaxis)))
    #frames.append(Frame(frame.point, frame.xaxis, yaxis))
# ---------- end python_3 ----------
python_4 = GhPythonScript()  # -> out, A, V, frames
# ---------- python_4: Python ----------
import math
from compas.geometry import Frame
from workshop_sjsu.reachability import FrameGenerator
import Rhino.Geometry as rg

V = []
A = rg.Point3d(*list(frame.point))

frames = []

for yaxis in FrameGenerator.orthonormal_vectors_from_axis_generator(frame.xaxis, math.radians(30)):
    print yaxis
    V.append(rg.Vector3d(*list(yaxis)))
    frames.append(Frame(frame.point, frame.xaxis, yaxis))
# ---------- end python_4 ----------
vdis = VectorDisplay(Anchor=python_3.A, Vector=python_3.V)
vdis_2 = VectorDisplay(Anchor=python_4.A, Vector=python_4.V)
draw = GhPythonScript(frames=python_3.frames, scale=Slider(0.1, range=0..1))  # -> P, V, C, W; inputs frames: list
# ---------- draw: Python ----------
from System.Drawing import Color
from compas_ghpython.utilities import draw_frame

red = Color.FromArgb(255, 0, 0)
green = Color.FromArgb(0, 255, 0)
blue = Color.FromArgb(0, 0, 255)

P = []
V = []
C = []

scale = float(scale)

for frame in frames:
    if not frame:
        continue
    plane = draw_frame(frame)
    P += [plane.Origin] * 3
    V.append(plane.XAxis * scale)
    V.append(plane.YAxis * scale)
    V.append(plane.ZAxis * scale)
    C += [red, green, blue]

W = 3
# ---------- end draw ----------
draw_2 = GhPythonScript(frames=python_4.frames, scale=Slider(0.1, range=0..1))  # -> P, V, C, W; inputs frames: list; same code as draw
vdisex = VectorDisplayEx(Point=draw.P, Vector=draw.V, Colour=draw.C, Width=draw.W)
vdisex_2 = VectorDisplayEx(Point=draw_2.P, Vector=draw_2.V, Colour=draw_2.C, Width=draw_2.W)

py_4 = PythonScript(reload=reload)
# ---------- py_4: Python ----------
if reload:
    from compas_ghpython import unload_modules
    unload_modules('compas')
    unload_modules('workshop_sjsu')
    unload_modules('compas_fab')
# ---------- end py_4 ----------
panel_2 = Panel("example04.json")
number_slider_3 = Slider(0.006, range=0..0.01)  # disabled
vec_2 = Vector(Vector(0, 0, 0.1))  # disabled
vec_3 = Vector(Vector(0.5, 0, 0.1))  # disabled

panel_3 = Panel("example01.json")
python_5 = GhPythonScript(DATA=py.DATA, filename="example03.json")  # -> filepath
# ---------- python_5: Python ----------
import os

filepath = os.path.join(DATA, filename)
# ---------- end python_5 ----------
python_6 = GhPythonScript(filepath=python_5, start_idx=Slider(4, range=0..10))  # -> points, values; inputs start_idx: Int32
# ---------- python_6: Python ----------
import json
from ghpythonlib.treehelpers import list_to_tree

with open(filepath, "r") as f:
    data = json.load(f)


import Rhino.Geometry as rg

print data.keys()

values = data['gradients']
points = [[rg.Point3d(*p) for p in pts] for pts in data['points3d']]

points = list_to_tree(points)
values = list_to_tree(values)
# ---------- end python_6 ----------
vec_4 = Vector(Vector(0, 1, 0))
python_7 = GhPythonScript(sphere=sphere, points=python_6.points, yaxis=vec_4)  # -> planes; inputs sphere: Surface, points: list
# ---------- python_7: Python ----------
import Rhino.Geometry as rg

planes = []
for pt in points:
    ok, u, v = sphere.ClosestPoint(pt)
    xaxis = -sphere.NormalAt(u, v)
    zaxis = rg.Vector3d.CrossProduct(xaxis, yaxis)
    yaxis_corr = rg.Vector3d.CrossProduct(zaxis, xaxis)
    planes.append(rg.Plane(pt, zaxis, yaxis_corr))
# ---------- end python_7 ----------
transform = Transform(Geometry=python_7)
python_8 = GhPythonScript(robot=robot, planes=transform)  # -> frames_tcf, frames_t0cf, planes_t0cf; inputs planes: list; same code as python_2

swatch = ColourSwatch(SwatchColor=RGB(112, 255, 210))  # disabled
sphere_2 = Sphere(R=number_slider_2, T=vec_2)  # disabled
geo = Geometry([Line((27.37796388, 0.5367892955, 0), (27.63477613, 2.289597485, 0)), Line((27.63477613, 2.289597485, 0), (29.33600454, 1.830921456, 0)), Line((29.33600454, 1.830921456, 0), (30.06502018, 3.437972606, 0)), Line((30.06502018, 3.437972606, 0), (28.48304606, 4.224271738, 0)), Line((28.48304606, 4.224271738, 0), (26.72203787, 4.088580826, 0)), Line((26.72203787, 4.088580826, 0), (26.52752794, 5.83958508, 0))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])  # disabled
pipe = Pipe(Curve=geo, Radius=number_slider, Caps=0)  # disabled
scale = Scale(Geometry=geo, Center=Point(0, 0, 0), Factor=number_slider_3)  # -> Geometry, Transform; disabled

vec_5 = VectorXYZ(XComponent=0, YComponent=0, ZComponent=Slider(0.024, range=0..0.1))  # -> Vector, Length
vec_6 = Vector(vec_5.Vector)
addition = Addition(B=vec_6)
xy_2 = XYPlane(Origin=addition)
python_9 = GhPythonScript(robot=robot, planes=xy_2)  # -> frames_tcf, frames_t0cf, planes_t0cf; inputs planes: list; same code as python_2

preview_3 = CustomPreview(Geometry=pipe, Material=swatch)  # disabled
geo_2 = Geometry(sphere_2)  # disabled
number_slider_4 = Slider(10, range=0..10)  # disabled
pt_3 = Point(python_6.points)
number_slider_5 = Slider(5, range=0..100)  # disabled
number_slider_6 = Slider(0, range=0..100)  # disabled
number_slider_7 = Slider(0, range=0..100)  # disabled
geo_3 = Geometry(python_7)
rad_3 = Radians(Degrees=number_slider_7)  # disabled
rad_4 = Radians(Degrees=number_slider_6)  # disabled
number_slider_8 = Slider(0.1, range=0..0.1)  # disabled
number_slider_9 = Slider(0.001, range=0..0.001)  # disabled
python_10 = GhPythonScript(sphere=geo_2, lines=scale.Geometry, mult=number_slider_5, move_u=rad_3, move_v=rad_4)  # -> out, L, a; inputs sphere: Surface, lines: list; disabled
# ---------- python_10: Python ----------
print sphere.Domain(0)
print sphere.Domain(1)
import Rhino.Geometry as rg

L = []

for line in lines:
    p0 = line.From
    p1 = line.To
    
    u, v = move_u + p0.X * mult, move_v + p0.Y * mult
    p0 = sphere.PointAt(u, v)
    u, v = move_u + p1.X * mult, move_v + p1.Y * mult
    p1 = sphere.PointAt(u, v)
    L.append(rg.Line(p0, p1))
# ---------- end python_10 ----------

# ---- group: forward kinematics
# Configuration
a2 = Slider(-23, range=-360..360)
a4 = Slider(-90, range=-360..360)
a5 = Slider(-90, range=-360..360)
a1 = Slider(-93, range=-360..360)
a3 = Slider(0, range=-360..360)
a6 = Slider(0, range=-360..360)
forward_kinematics = PythonScript(robot=robot, a1=a1, a2=a2, a3=a3, a4=a4, a5=a5, a6=a6)  # -> configuration
# ---------- forward_kinematics: Python ----------
import math
from compas.robots import Configuration

if robot:
    joint_values = [a1, a2, a3, a4, a5, a6]
    joint_names = robot.get_configurable_joint_names()
    configuration = Configuration.from_revolute_values([math.radians(a) for a in joint_values])
# ---------- end forward_kinematics ----------

# ----
end = EndPoints(Curve=python_10.L)  # -> Start, End; disabled
number_slider_10 = Slider(200, range=0..10000)  # disabled
pipe_2 = Pipe(Curve=python_10.L, Radius=number_slider_9, Caps=0)  # disabled
number_slider_11 = Slider(0.06, range=0..1)  # disabled
nurbs = NurbsCurve(Vertices=end.Start, Degree=3, Periodic=False)  # -> Curve, Length, Domain; disabled
brep_cp = BrepClosestPoint(Point=end.Start)  # -> Point, Normal, Distance; disabled
mesh_3 = MeshBrep(
    Brep=flatten(pipe_2),
    Settings={GridMaxCount=0, GridMinCount=16, JaggedSeams=False, MaxEdgeLength=0, MinEdgeLength=0.0001, MinTolerance=0, Refine=True, RefineAngle=0, RelativeTolerance=0.65, SimplePlanes=True, Tolerance=0})  # disabled
python_11 = GhPythonScript()  # -> out, configuration
# ---------- python_11: Python ----------
from compas.robots import Configuration


values = [-1.24253, -2.46163, -1.0515, -2.52326, 0.814206, 3.12594]
#values = [-3.03094, -2.46952, -1.02144, -2.74023, 2.47958, 3.12582]
#values = [-2.13815, -2.60958, -1.0153, -2.43862, 1.63439, 3.12594]
values = [0.939368, -1.46446, 1.80162, -1.73483, 3.91841, 3.55271e-15]


import math

values[0] += math.pi

configuration = Configuration.from_revolute_values(values)
# ---------- end python_11 ----------
number_slider_12 = Slider(100, range=0..100)  # disabled
number_slider_13 = Slider(91, range=0..100)  # disabled
python_12 = GhPythonScript(M=mesh_3, i=number_slider_10)  # -> out, M; inputs M: list, i: Int32; disabled
# ---------- python_12: Python ----------
M = M[:i]
# ---------- end python_12 ----------
swatch_2 = ColourSwatch(SwatchColor=RGB(112, 255, 210))  # disabled
python_13 = GhPythonScript(p=brep_cp.Point, n=brep_cp.Normal, off=number_slider_11)  # -> frame, plane; disabled
# ---------- python_13: Python ----------
from compas.geometry import Frame
import Rhino.Geometry as rg

plane = rg.Plane(p, n)
#plane = rg.Plane(plane.Origin, plane.ZAxis, plane.XAxis)
plane = rg.Plane(plane.Origin, plane.YAxis, plane.XAxis)

plane.Origin -= plane.ZAxis * off

frame = Frame(plane.Origin, plane.XAxis, plane.YAxis)
# ---------- end python_13 ----------
panel_4 = Panel("test01")  # disabled
preview_4 = CustomPreview(Geometry=pipe_2, Material=swatch_2)  # disabled
panel_5 = Panel("mesh_data.json")  # disabled
button = Button()  # disabled
py_5 = GhPythonScript(meshes=python_12.M)  # -> cmeshes; inputs meshes: list; disabled
# ---------- py_5: Python ----------
import os
from compas_rhino.geometry import RhinoMesh
from compas.geometry import Transformation, Frame, Scale

T = Transformation.from_frame_to_frame(Frame.worldXY(), Frame.worldZX())
S = Scale.from_factors([10.] * 3)
T = S * T

cmeshes = []
for i, mesh in enumerate(meshes):
    cmesh = RhinoMesh.from_geometry(mesh).to_compas()
    cmesh.quads_to_triangles()
    cmesh.transform(T)
    cmeshes.append(cmesh)
# ---------- end py_5 ----------
button_2 = Button()  # disabled
python_14 = GhPythonScript()  # -> material; disabled
# ---------- python_14: Python ----------
import sys
from compas_rhino import unload_modules
from compas.files.gltf import GLTFContent

from compas.files.gltf.data_classes import MaterialData, PBRMetallicRoughnessData
from compas.files.gltf.extensions import KHR_materials_pbrSpecularGlossiness


material = MaterialData()
material.name = 'Plaster'
material.pbr_metallic_roughness = PBRMetallicRoughnessData()
material.pbr_metallic_roughness.base_color_factor = [0.156862751, 0.831372559, 0.7764706, 1.0]
material.double_sided = True
pbr_specular_glossiness = KHR_materials_pbrSpecularGlossiness()
pbr_specular_glossiness.diffuse_factor = [0.156862751, 0.831372559, 0.7764706, 1.0]
pbr_specular_glossiness.specular_factor = [0.0, 0.0, 0.0]
pbr_specular_glossiness.glossiness_factor = 0.
material.add_extension(pbr_specular_glossiness)
# ---------- end python_14 ----------
list = ValueList({"0", "1", "2", "3"}, selected="0")
python_15 = GhPythonScript(planes=python_13.plane, i=number_slider_13)  # -> out, planes; inputs planes: list, i: Int32; disabled
# ---------- python_15: Python ----------
planes = planes[:i]
# ---------- end python_15 ----------
filter = StreamFilter(Gate=list, Stream0=forward_kinematics, Stream1=python_11.configuration)
export = GhPythonScript(cmeshes=py_5, WEB=py.WEB, name=panel_4, write=button, material=python_14)  # inputs cmeshes: list; disabled
# ---------- export: Python ----------
import os
from compas.files import GLTFContent
from compas.files import GLTFExporter

GLB = os.path.join(WEB, "glb")
filepath = os.path.join(GLB, name + ".glb")

if write:

    content = GLTFContent()
    scene = content.add_scene("half-sphere")
    content.add_material(material)
    
    for i, cmesh in enumerate(cmeshes):
        key = "line_%05d" % i
        node = content.add_node_to_scene(scene, node_name=key)
        mesh_data = content.add_mesh_to_node(node, cmesh)
        #mesh_data.primitive_data_list[0].material = material
    
    exporter = GLTFExporter(filepath, content, embed_data=True)
    exporter.export()
    
    # write html
    example_html = os.path.join(WEB, "example00.html")

    with open(example_html) as f:
        contents = f.read()
    contents = contents.replace("example00", name)
    
    new_html = os.path.join(WEB, "%s.html" % name)
    with open(new_html, 'w+') as f:
        f.write(contents)
# ---------- end export ----------
export_2 = GhPythonScript(cmeshes=py_5, DATA=py.DATA, filename=panel_5, write=button_2)  # inputs cmeshes: list; disabled
# ---------- export_2: Python ----------
import os
import json
from compas.files import GLTFContent
from compas.files import GLTFExporter
from compas_rhino.geometry import RhinoMesh

from compas.geometry import Transformation, Frame, Scale


filepath = os.path.join(DATA, filename)

if write:
    data = [mesh.data for mesh in cmeshes]
    with open(filepath, 'w+') as f:
        json.dump(data, f)
# ---------- end export_2 ----------

# ----
# Visualisation
show_end_effector_frame = BooleanToggle(True)
show_base_frame = BooleanToggle(False)
show_collision = BooleanToggle(False)
show_frames = BooleanToggle(False)
show_visual = BooleanToggle(True)
show_acm = BooleanToggle(True)
robot_visualize = RobotVisualize(
    robot=robot,
    configuration=filter,
    show_visual=show_visual,
    show_collision=show_collision,
    show_frames=show_frames,
    show_base_frame=show_base_frame,
    show_end_effector_frame=show_end_effector_frame,
    show_acm=show_acm)  # -> visual, collision, attached_meshes, frames, base_frame, ee_frame; inputs attached_collision_meshes: list, show_visual: Boolean, show_collision: Boolean, show_frames: Boolean, show_base_frame: Boolean, show_end_effector_frame: Boolean, show_acm: Boolean
#   port group: The planning group used for end-effector and base visualization.
#   port configuration: The robot's full configuration.
#   port attached_collision_meshes: A list of attached collision meshes.
#   port show_visual: Whether or not to show the robot's visual meshes.
#   port show_collision: Whether or not to show the robot's collision meshes.
#   port show_frames: Whether or not to show the robot's joint frames.
#   port show_base_frame: Whether or not to show the robot's base frame.
#   port show_end_effector_frame: Whether or not to show the robot's end-effector frame.
#   port show_acm: Whether or not to show the attached collision meshes (if any).
#   port visual: The robot's visual Rhino meshes (if any).
#   port collision: The robot's collision Rhino meshes (if any).
#   port attached_meshes: The attached collision Rhino meshes (if any).
#   port frames: The robot's joint frames as Rhino planes (if any).
#   port base_frame: The robot's base frame as a Rhino plane (if any).
#   port ee_frame: The robot's end-effector frame as a Rhino plane (if any).
# ---------- robot_visualize: Python ----------
"""
Visualizes the robot.

COMPAS FAB v0.19.1
"""
from compas.geometry import Frame
from compas.geometry import Transformation
from compas_ghpython.artists import FrameArtist
from compas_ghpython.artists import MeshArtist
from ghpythonlib.componentbase import executingcomponent as component


class RobotVisualize(component):
    def RunScript(self, robot, group, configuration, attached_collision_meshes, show_visual, show_collision,
                  show_frames, show_base_frame, show_end_effector_frame, show_acm):

        visual = None
        collision = None
        attached_meshes = None
        frames = None
        base_frame = None
        ee_frame = None

        if robot:
            show_visual = True if show_visual is None else show_visual
            configuration = configuration or robot.zero_configuration()

            robot.update(configuration, visual=show_visual, collision=show_collision)
            compas_frames = robot.transformed_frames(configuration, group)

            if show_visual:
                visual = robot.artist.draw_visual()

            if show_collision:
                collision = robot.artist.draw_collision()

            if show_base_frame:
                base_compas_frame = compas_frames[0]
                artist = FrameArtist(base_compas_frame)
                base_frame = artist.draw()

            if show_end_effector_frame:
                ee_compas_frame = robot.forward_kinematics(configuration, group, options=dict(solver='model'))
                artist = FrameArtist(ee_compas_frame)
                ee_frame = artist.draw()

            if show_frames:
                frames = []
                for compas_frame in compas_frames[1:]:
                    artist = FrameArtist(compas_frame)
                    frame = artist.draw()
                    frames.append(frame)

            if show_acm:
                attached_meshes = []
                for acm in attached_collision_meshes:
                    frame = robot.forward_kinematics(configuration, options=dict(solver='model', link_name=acm.link_name))
                    T = Transformation.from_frame_to_frame(Frame.worldXY(), frame)
                    mesh = acm.collision_mesh.mesh.transformed(T)
                    attached_meshes.append(MeshArtist(mesh).draw())

        return (visual, collision, attached_meshes, frames, base_frame, ee_frame)
# ---------- end robot_visualize ----------
geo_4 = Geometry(robot_visualize.collision)
geo_5 = Geometry(robot_visualize.visual)
draw_3 = GhPythonScript(
    frames=flatten([robot_visualize.frames, robot_visualize.base_frame, robot_visualize.ee_frame]),
    scale=Slider(0.1, range=0..1))  # -> P, V, C, W; inputs frames: list
# ---------- draw_3: Python ----------
from System.Drawing import Color
from compas_ghpython.utilities import draw_frame

red = Color.FromArgb(255, 0, 0)
green = Color.FromArgb(0, 255, 0)
blue = Color.FromArgb(0, 0, 255)

P = []
V = []
C = []

scale = float(scale)

for frame in frames:
    if not frame:
        continue
    plane = frame
    P += [plane.Origin] * 3
    V.append(plane.XAxis * scale)
    V.append(plane.YAxis * scale)
    V.append(plane.ZAxis * scale)
    C += [red, green, blue]

W = 3
# ---------- end draw_3 ----------
item = ListItem(List=geo_5, Index=[0, 1, 2, 3, 4, 5, 6], Wrap=True)
item_2 = ListItem(List=geo_5, Index=7, Wrap=True)
preview_5 = CustomPreview(Geometry=item_2, Material=ColourSwatch(SwatchColor=RGB(0, 0, 0)))
preview_6 = CustomPreview(Geometry=item, Material=ColourSwatch(SwatchColor=RGB(255, 255, 255)))
vdisex_3 = VectorDisplayEx(Point=draw_3.P, Vector=draw_3.V, Colour=draw_3.C, Width=draw_3.W)

list_2 = ValueList({"0", "1", "2"}, selected="0")
lng = ListLength(List=python_2.frames_tcf)
python_16 = GhPythonScript(num=lng)  # -> values
# ---------- python_16: Python ----------
values = [i/(num-1) for i in range(num)]
# ---------- end python_16 ----------
filter_2 = StreamFilter(Gate=list_2, Stream0=python_8.frames_tcf, Stream1=python_2.frames_tcf, Stream2=python_9.frames_tcf)
filter_3 = StreamFilter(Gate=list_2, Stream0=python_8.frames_t0cf, Stream1=python_2.frames_t0cf, Stream2=python_9.frames_t0cf)

python_17 = GhPythonScript(values=python_6.values, minv=Slider(0.001, range=0..1), maxv=Slider(0.4, range=0..1))  # -> values_remap; inputs values: list
# ---------- python_17: Python ----------
from compas_fab.utilities import map_range
minv_in = min(values) 
maxv_in = max(values) 

values_remap = []
for v in values:
    values_remap.append(map_range(v, minv_in, maxv_in, minv, maxv))
# ---------- end python_17 ----------
graph = QuickGraph(python_17, SortOrder=0)

graph_2 = GraphMapper(python_16, x0=0, x1=1, y0=0, y1=1, container_name="Bezier", cpx=[0, 1, 1, 1], cpy=[0, 0, 0.1837803721, 1])
python_18 = GhPythonScript(num=lng, minv=Slider(0.001, range=0..1), maxv=Slider(0.4, range=0..1))  # -> values_remap
# ---------- python_18: Python ----------
values_remap = []
step = (maxv - minv)/(num - 1)
for i in range(num):
    values_remap.append(minv + i*step)
# ---------- end python_18 ----------
python_19 = GhPythonScript(robot=robot, frames=filter_3, idx=Slider(2, range=0..10))  # -> configurations; inputs frames: list, idx: Int32
# ---------- python_19: Python ----------
from workshop_sjsu.ur.kinematics.analytical_inverse_kinematics import UR5AnalyticalIK

configurations = []

for frame in frames:
    c = UR5AnalyticalIK().inverse_kinematics(robot, frame)
    configurations.append(c[idx])
# ---------- end python_19 ----------
sphere_3 = Geometry(sphere)
graph_3 = QuickGraph(python_18, SortOrder=0)
multiplication = Multiplication(A=graph_2, B=Slider(0.3, range=0..1))
addition_2 = Addition(A=Slider(0.01, range=0..1), B=multiplication)
crv_3 = Curve(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)
item_3 = ListItem(List=python_19, Index=Slider(0, range=0..1000), Wrap=True)
number_slider_14 = Slider(-180, range=-180..180)  # disabled
line = Line(crv_3)  # disabled
number_slider_15 = Slider(110, range=0..360)  # disabled
data = Data(addition_2)
number_slider_16 = Slider(0.4, range=0..1)  # disabled
number_slider_17 = Slider(170, range=0..360)  # disabled
rad_5 = Radians(Degrees=Slider(-35, range=-180..1000))  # disabled
rad_6 = Radians(Degrees=Slider(200, range=0..1000))  # disabled
number_slider_18 = Slider(140, range=0..360)  # disabled
number_slider_19 = Slider(190, range=0..360)  # disabled
graph_4 = QuickGraph(data, SortOrder=0)
python_20 = GhPythonScript(line=line)  # -> out, center, plane; disabled
# ---------- python_20: Python ----------
import Rhino.Geometry as rg

center = line.PointAt(0.5)


plane = rg.Plane(center, line.Direction, rg.Vector3d.ZAxis)
# ---------- end python_20 ----------
rad_7 = Radians(Degrees=number_slider_14)  # disabled
dom = ConstructDomain(DomainStart=rad_5, DomainEnd=rad_6)  # disabled
number_slider_20 = Slider(20, range=0..100)  # disabled
arc = Arc(Plane=python_20.plane, Radius=number_slider_16, Angle=dom)  # -> Arc, Length; disabled
rad_8 = Radians(Degrees=number_slider_15)  # disabled
brep_2 = Brep(sphere_3)  # disabled
list_3 = ValueList({"0", "1"}, selected="0")  # disabled
rad_9 = Radians(Degrees=number_slider_17)  # disabled
rad_10 = Radians(Degrees=number_slider_18)  # disabled
rad_11 = Radians(Degrees=number_slider_19)  # disabled
number_slider_21 = Slider(25, range=0..100)  # disabled
number_slider_22 = Slider(25, range=0..100)  # disabled
number_slider_23 = Slider(10, range=0..10)  # disabled
number_slider_24 = Slider(20, range=0..100)  # disabled
vec_7 = Vector(Vector(0, 0, -0.3))  # disabled
python_21 = GhPythonScript(sphere=sphere_3, direction=list_3, u=rad_8, v=rad_7)  # -> crv; inputs sphere: Surface; disabled
# ---------- python_21: Python ----------
print sphere.Domain(0)
print sphere.Domain(1)
import Rhino.Geometry as rg

if direction == 0:
    crv = sphere.IsoCurve(direction, u)

if direction == 1:
    crv = sphere.IsoCurve(direction, v)
print crv
# ---------- end python_21 ----------
python_22 = GhPythonScript(sphere=sphere_3, direction=list_3, u=rad_10, v=rad_7)  # -> crv; inputs sphere: Surface; disabled; same code as python_21
python_23 = GhPythonScript(sphere=sphere_3, direction=list_3, u=rad_9, v=rad_7)  # -> crv; inputs sphere: Surface; disabled; same code as python_21
python_24 = GhPythonScript(sphere=sphere_3, direction=list_3, u=rad_11, v=rad_7)  # -> crv; inputs sphere: Surface; disabled; same code as python_21
divide_2 = DivideCurve(Curve=arc.Arc, Count=number_slider_20, Kinks=False)  # -> Points, Tangents, Parameters; disabled
addition_3 = Addition(A=python_20.center, B=vec_7)  # disabled
hframes = HorizontalFrames(Curve=arc.Arc, Count=number_slider_20)  # -> Frames, Parameters; disabled
crv_4 = Curve([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])  # disabled
geo_6 = Geometry(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)  # disabled
python_25 = GhPythonScript(R=addition_3, N=number_slider_24, crv=python_22)  # -> out, planes; disabled
# ---------- python_25: Python ----------
import Rhino.Geometry as rg
import math

params = crv.DivideByCount(N, True)
tangents = [crv.TangentAt(p) for p in params]
points = [crv.PointAt(p) for p in params]

planes = [crv.FrameAt(p)[1] for p in params]
planes = []
for pt in points:
    zdir = R - pt
    zdir.Unitize()
    xaxis = rg.Vector3d.XAxis
    yaxis = rg.Vector3d.CrossProduct(zdir, xaxis)
    xaxis = rg.Vector3d.CrossProduct(yaxis, zdir)
    plane = rg.Plane(pt, xaxis, yaxis)
    planes.append(plane)
# ---------- end python_25 ----------
python_26 = GhPythonScript(R=addition_3, N=number_slider_23, crv=python_21)  # -> out, planes; disabled; same code as python_25
python_27 = GhPythonScript(R=addition_3, N=number_slider_21, crv=python_23)  # -> out, planes; disabled; same code as python_25
python_28 = GhPythonScript()  # -> Out, A; disabled
python_29 = GhPythonScript(R=addition_3, N=number_slider_22, crv=python_24)  # -> out, planes; disabled; same code as python_25
python_30 = GhPythonScript()  # -> out, plane; disabled
# ---------- python_30: Python ----------
pose = [-180.888, -567.403, -117.344, -1.19591, 0.175676, 1.75602]


from compas.geometry import Frame
from compas_ghpython import draw_frame

frame = Frame.from_axis_angle_vector(pose[3:], point=pose[:3])
frame.point /= 1000.

print frame.point
plane = draw_frame(frame)
# ---------- end python_30 ----------
pln = Plane(flatten([python_26.planes, python_25.planes, python_27.planes, python_29.planes]))  # disabled
python_31 = GhPythonScript(plane=pln)  # -> out, A, V; disabled
# ---------- python_31: Python ----------
A = plane.Origin
V = plane.ZAxis * 0.2
# ---------- end python_31 ----------
py_6 = GhPythonScript(tree=python_19)  # -> array; inputs tree: tree
# ---------- py_6: Python ----------
array = []
for i in range(tree.BranchCount):
    path = tree.Path(i)
    alist = list(tree.Branch(path))
    array.append(list(alist))
# ---------- end py_6 ----------
py_7 = GhPythonScript(tree=python_17)  # -> array; inputs tree: tree
# ---------- py_7: Python ----------
array = []
for i in range(tree.BranchCount):
    path = tree.Path(i)
    alist = list(tree.Branch(path))
    print alist
    array.append(list(alist))
# ---------- end py_7 ----------
py_8 = GhPythonScript(tree=filter_2)  # -> array; inputs tree: tree; same code as py_6
number_slider_25 = Slider(-120, range=-180..100)  # disabled
vdis_3 = VectorDisplay(Anchor=python_31.A, Vector=python_31.V)  # disabled

configurations = Data(py_6)
list_4 = ValueList({"multiple": 0, "one": 1}, selected="one")
item_4 = ListItem(List=configurations, Index=Slider(0, range=0..100), Wrap=True)
filter_4 = StreamFilter(Gate=list_4, Stream0=configurations, Stream1=item_4)

python_32 = GhPythonScript(crv=arc.Arc, N=number_slider_20, angle=number_slider_25)  # -> out, planes, a; inputs crv: Curve; disabled
# ---------- python_32: Python ----------
import math
import Rhino.Geometry as rg
import rhinoscriptsyntax as rs


params = crv.DivideByCount(N, True)
tangents = [crv.TangentAt(p) for p in params]
points = [crv.PointAt(p) for p in params]

planes = [crv.FrameAt(p)[1] for p in params]

# z points towards light

planes = [rg.Plane(pln.Origin, pln.ZAxis, pln.XAxis) for pln in planes]

rotations = [rg.Transform.Rotation(math.radians(angle), pln.ZAxis, pln.Origin) for pln in planes]

[pln.Transform(R) for pln, R in zip(planes, rotations)]
# ---------- end python_32 ----------
python_33 = GhPythonScript(plane=python_32.planes)  # -> out, A, V; disabled; same code as python_31
vdis_4 = VectorDisplay(Anchor=python_33.A, Vector=python_33.V)  # disabled
number_slider_26 = Slider(0.3, range=0..1)
list_5 = ValueList({"multiple": 0, "one": 1}, selected="multiple")

frames_tcf = Data(py_8)
item_5 = ListItem(List=frames_tcf, Index=Slider(0, range=0..100), Wrap=True)
filter_5 = StreamFilter(Gate=list_5, Stream0=frames_tcf, Stream1=item_5)

list_6 = ValueList({"0", "1", "2"}, selected="0")
number_slider_27 = Slider(0.023, range=0..0.05)  # disabled
filter_6 = StreamFilter(Gate=list_6, Stream0=py_7, Stream1=Slider(0.1, range=0..1), Stream2=data)
pln_2 = Plane(pln)  # disabled
number_slider_28 = Slider(0.16, range=0.01..0.2)  # disabled

python_34 = GhPythonScript(planes=python_32.planes)  # -> planes; inputs planes: list; disabled
# ---------- python_34: Python ----------
mididx = int(len(planes)/2)

planes = [planes[mididx], planes[0]]
# ---------- end python_34 ----------
python_35 = GhPythonScript(planes=python_34, velocity=number_slider_28, radius=number_slider_27)  # -> out, script, point; inputs planes: list; disabled
# ---------- python_35: Python ----------
from compas.geometry import Frame
vel = 0.01

script = ""
script += "def program():\n"
script += "\ttextmsg(\">> Entering program.\")\n"

script += "\ttextmsg(\">> Entering program.\")\n"



for plane in planes:
    point = list(plane.Origin)
    frame = Frame(plane.Origin, plane.XAxis, plane.YAxis)
    pose = list(frame.point) + list(frame.axis_angle_vector)
    posestr = "p[%.5f, %.5f, %.5f, %.5f, %.5f, %.5f]" % tuple(pose)
    script += "\tmovel(%s, v=%.5f, r=%.5f)\n" % (posestr, velocity, radius)


#pose = [-441.251/1000, -494.832/1000, 12.6216/1000, -1.73381, 0.543383, -0.472034]
#import Rhino.Geometry as rg
#point = rg.Point3d(*pose[:3])
#posestr = "p[%.5f, %.5f, %.5f, %.5f, %.5f, %.5f]" % tuple(pose)
#script += "\tmovel(%s, v=%.5f)\n" % (posestr, vel)

script += "\ttextmsg(\"<< Exiting program.\")\n"
script += "end\n"
script += "program()\n\n\n"

print script
# ---------- end python_35 ----------
panel_6 = Panel("192.168.10.10")  # disabled
button_3 = Button()  # disabled
python_36 = GhPythonScript(script=python_35.script, ur_ip=panel_6, send=button_3)  # -> out, a; disabled
# ---------- python_36: Python ----------
import socket
import os

UR_SERVER_PORT = 30002

def send_script(ur_ip, script):
    global UR_SERVER_PORT
    try:
        s = socket.create_connection((ur_ip, UR_SERVER_PORT), timeout=2)
        s.send(script)
        print("Script sent to %s on port %i" % (ur_ip, UR_SERVER_PORT))
        s.close()
    except socket.timeout:
        print("UR with ip %s not available on port %i" % (ur_ip, UR_SERVER_PORT))
        raise


if send:
    send_script(ur_ip, script)
# ---------- end python_36 ----------

python_37 = GhPythonScript(planes=pln_2)  # -> planes; inputs planes: list; disabled
# ---------- python_37: Python ----------
planes = [planes[0]]
# ---------- end python_37 ----------
python_38 = GhPythonScript(planes=python_37, velocity=number_slider_28, radius=number_slider_27)  # -> out, script, point; inputs planes: list; disabled; same code as python_35
panel_7 = Panel("192.168.10.10")  # disabled
button_4 = Button()  # disabled
python_39 = GhPythonScript(script=python_38.script, ur_ip=panel_7, send=button_4)  # -> out, a; disabled; same code as python_36

python_40 = GhPythonScript(configurations=python_19)  # -> out, trajectory; inputs configurations: list
# ---------- python_40: Python ----------
from compas_fab.robots import JointTrajectoryPoint, JointTrajectory


joint_names = configurations[0].joint_names

jtpts = []
for c in configurations:
    values = [v for v in c.values()]
    jtpt = JointTrajectoryPoint.from_revolute_values(values, joint_names=c.joint_names)
    jtpts.append(jtpt)

trajectory = JointTrajectory(trajectory_points=jtpts, joint_names=joint_names, fraction=None)
# ---------- end python_40 ----------

# ----
# moveL
number_slider_29 = Slider(0.005, range=0..0.05)
python_41 = GhPythonScript(tool=attach_tool.tool, curves=filter_5, velocity=filter_6, radius=number_slider_29)  # -> script; inputs curves: list, velocity: list
# ---------- python_41: Python ----------
import math
from compas.geometry import Frame


#if len(velocity) != 1:
#    assert(len(velocity) == len(frames))

script = ""
script += "def program():\n"
script += "\ttextmsg(\">> Entering program.\")\n"

x, y, z = tool.frame.point
tool_frame_ur = Frame((y, z, x), -tool.frame.yaxis, tool.frame.zaxis)
tool_pose = list(tool_frame_ur.point) + list(tool_frame_ur.axis_angle_vector)
script += "\tset_tcp(p[%.5f, %.5f, %.5f, %.5f, %.5f, %.5f])\n" % tuple(tool_pose)



for k, frames in enumerate(curves):
    for i, frame in enumerate(frames):
        #frame_ur = Frame(frame.point, -frame.yaxis, -frame.zaxis)
        
        speed = velocity[0] if len(velocity[k]) == 1 else velocity[k][i]
        frame_ur = frame
        pose = list(frame_ur.point) + list(frame_ur.axis_angle_vector)
        script += "\ttextmsg(\"%i of %i.\")\n" % (i+1, len(frames))
        posestr = "p[%.5f, %.5f, %.5f, %.5f, %.5f, %.5f]" % tuple(pose)
        script += "\tmovel(%s, v=%.4f, r=%.4f)\n" % (posestr, speed, radius)

        

script += "\ttextmsg(\"<< Exiting program.\")\n"
script += "end\n"
script += "program()\n\n\n"

print script
# ---------- end python_41 ----------
python_42 = GhPythonScript(script=python_41, ur_ip="192.168.10.10", send=Button())  # same code as python_36

number_slider_30 = Slider(0.01, range=0..0.05)
python_43 = GhPythonScript(planes=pln_2, velocity=number_slider_28, radius=number_slider_27)  # -> out, script, point; inputs planes: list; disabled; same code as python_35
panel_8 = Panel("192.168.10.10")  # disabled
panel_9 = Panel("C:\Users\rustr\workspace")  # disabled
trajectory_visualize = TrajectoryVisualize(robot=robot, trajectory=python_40.trajectory)  # -> start_configuration, configurations, fraction, time, planes, P, V, A
#   port group: The planning group for which this trajectory was planned.
#   port trajectory: The calculated trajectory.
#   port start_configuration: The start configuration of the trajectory.
#   port configurations: The full configurations along the trajectory.
#   port fraction: Indicates the fraction of requested trajectory that was calculated, e.g. 1 means the full trajectory was found.
#   port time: The time which is needed to execute that trajectory at full speed.
#   port planes: The planes of the robot's end-effector.
#   port P: The positions along the trajectory
#   port V: The velocities along the trajectory
#   port A: The accelerations along the trajectory
# ---------- trajectory_visualize: Python ----------
"""
Visualizes a trajectory.

COMPAS FAB v0.19.1
"""
from compas_ghpython import draw_frame
from compas_ghpython import list_to_ghtree
from ghpythonlib.componentbase import executingcomponent as component


class TrajectoryVisualize(component):
    def RunScript(self, robot, group, trajectory):
        start_configuration = None
        configurations = []
        fraction = 0.
        time = 0.

        planes = []
        positions = []
        velocities = []
        accelerations = []

        if robot and trajectory:
            group = group or robot.main_group_name

            for c in trajectory.points:
                configurations.append(robot.merge_group_with_full_configuration(c, trajectory.start_configuration, group))
                frame = robot.forward_kinematics(c, group, options=dict(solver='model'))
                planes.append(draw_frame(frame))
                positions.append(c.positions)
                velocities.append(c.velocities)
                accelerations.append(c.accelerations)

            start_configuration = trajectory.start_configuration
            fraction = trajectory.fraction
            time = trajectory.time_from_start

        P = list_to_ghtree(list(zip(*positions)))
        V = list_to_ghtree(list(zip(*velocities)))
        A = list_to_ghtree(list(zip(*accelerations)))

        # return outputs if you have them; here I try it for you:
        return (start_configuration, configurations, fraction, time, planes, P, V, A)
# ---------- end trajectory_visualize ----------
button_5 = Button()  # disabled

# ----
# moveJ
panel_10 = Panel("192.168.10.10")
python_44 = GhPythonScript(curves=filter_4, velocity=Slider(10, range=0..10), radius=Slider(0.005, range=0..0.05))  # -> script; inputs curves: list
# ---------- python_44: Python ----------
import math
from compas.geometry import Frame

from workshop_sjsu.ur.kinematics.utils import get_smaller_angle

script = ""
script += "def program():\n"
script += "\ttextmsg(\">> Entering program.\")\n"


for k, configurations in enumerate(curves):
    
    for i, config in enumerate(configurations):
        
        values = [v for v in config.values()]
        values[0] -= math.pi # this ur_spec
        
        values[1] -= 2 * math.pi
        values[4] -= 2 * math.pi
        
        values[5] = max(min(2 * math.pi - 0.1, values[5]), -2 * math.pi + 0.1)
        #print [math.degrees(v) for v in values]
        #values = [get_smaller_angle(v) for v in values]
        #print [math.degrees(v) for v in values]
        script += "\ttextmsg(\"%i of %i.\")\n" % (i+1, len(configurations))
        values_str = "[%.5f, %.5f, %.5f, %.5f, %.5f, %.5f]" % tuple(values)
        script += "\tmovej(%s, v=%.5f, r=%.5f)\n" % (values_str, velocity, radius)

script += "\ttextmsg(\"<< Exiting program.\")\n"
script += "end\n"
script += "program()\n\n\n"

print script
# ---------- end python_44 ----------
python_45 = GhPythonScript(script=python_44, ur_ip=panel_10, send=Button())  # same code as python_36

python_46 = GhPythonScript(script=python_43.script, ur_ip=panel_8, send=button_5)  # -> out, a; disabled; same code as python_36
graph_5 = QuickGraph(trajectory_visualize.P, SortOrder=0)
python_47 = GhPythonScript(path=panel_9)  # -> out, a; disabled
# ---------- python_47: Python ----------
import sys
print path
sys.path.append(path)
# ---------- end python_47 ----------
panel_11 = Panel(python_41)
python_48 = GhPythonScript()  # -> out, a; disabled
# ---------- python_48: Python ----------
from SocketServer import TCPServer, BaseRequestHandler
from utilities import send_script, is_available

script = ""
script += "def program():\n"
script += "\ttextmsg(\">> Entering program.\")\n"
script += "\tSERVER_ADDRESS = \"{SERVER_ADDRESS}\"\n"
script += "\tPORT = {PORT}\n"
script += "\ttextmsg(SERVER_ADDRESS)\n"
script += "\ttextmsg(PORT)\n"
script += "\tset_tcp(p{TCP})\n"
script += "\tsocket_open(SERVER_ADDRESS, PORT)\n"
script += "\tcurrent_pose = get_joint_positions()\n"
script += "\ttextmsg(current_pose)\n"
script += "\tsocket_send_string([current_pose[0], current_pose[1], current_pose[2], current_pose[3], current_pose[4], current_pose[5]])\n"
script += "\tsocket_close()\n"
script += "\ttextmsg(\"<< Exiting program.\")\n"
script += "end\n"
script += "program()\n\n\n"

def list_str_to_list(str):
    str = str[(str.find("[")+1):str.find("]")]
    return [float(x) for x in str.split(",")]

class MyTCPHandler(BaseRequestHandler):

    def handle(self):
        # self.request is the TCP socket connected to the client
        pose = ""
        while pose.find("]") == -1:
            pose += self.request.recv(1024).decode()
        self.server.rcv_msg = pose
        self.server.server_close() # this throws an exception


def get_current_pose_joints(server_ip, server_port, ur_ip, tool_angle_axis):

    global script
    script = script.replace("{SERVER_ADDRESS}", server_ip)
    script = script.replace("{PORT}", str(server_port))
    script = script.replace("{TCP}", str([tool_angle_axis[i] if i >= 3 else tool_angle_axis[i]/1000. for i in range(len(tool_angle_axis))]))

    print(script)

    ur_available = is_available(ur_ip)

    if ur_available:
        # start server
        server = TCPServer((server_ip, server_port), MyTCPHandler)

        send_script(ur_ip, script)
        # send file
        try:
            server.serve_forever()
        except:
            return list_str_to_list(server.rcv_msg)


server_port = 30005
server_ip = "192.168.10.11"
ur_ip = "192.168.10.10"
tool_angle_axis = [0,0,0,0,0,0]

pose = get_current_pose_joints(server_ip, server_port, ur_ip, tool_angle_axis)

print("pose", pose)
# ---------- end python_48 ----------
panel_12 = Panel(python_43.script)  # disabled

frames_t0cf = Data(python_8.frames_t0cf)
python_49 = GhPythonScript(DATA=py.DATA, filename="frames_t0cf.json")  # -> filepath; same code as python_5

py_9 = GhPythonScript(tree=frames_t0cf)  # -> array; inputs tree: tree; same code as py_6

to_json_3 = ToJSON(data=py_9, filepath=python_49, pretty=Toggle(False))  # -> json; inputs data: list, pretty: Boolean; same code as to_json
panel_13 = Panel(to_json_3)

# ==== cluster Sphere
T = ClusterInput()
R = ClusterInput()
sph = Sphere(Base=PlaneXY(0, 0, 0), Radius=R)
rad = Radians(Degrees=Slider(90, range=0..100))
xz = XZPlane(Origin=Point(0, 0, 0))
rotate = Rotate(Geometry=sph, Angle=rad, Plane=xz)  # -> Geometry, Transform
move = Move(Geometry=rotate.Geometry, Motion=T)  # -> Geometry, Transform
G = ClusterOutput(move.Geometry)

# ==== cluster Cluster
filename = ClusterInput()
python = GhPythonScript(filename=filename)  # -> filepath
# ---------- python: Python ----------
import os
from workshop_sjsu import DATA

filepath = os.path.join(DATA, filename)
# ---------- end python ----------
filepath = ClusterOutput(python)

# ==== cluster Cluster_2
M = ClusterInput()
py = GhPythonScript(M=M)  # -> mesh, data
# ---------- py: Python ----------
from compas_rhino.geometry import RhinoMesh

mesh = RhinoMesh.from_geometry(M).to_compas()
data = [mesh.data]
# ---------- end py ----------
mesh = ClusterOutput(py.mesh)
data = ClusterOutput(py.data)
